# Grasshopper definition example file.gh (Grasshopper 1.0.8)
# plug-ins: Speckle 2, Heteroptera, SpeckleProjectManager, LadybugGrasshopper, MetaHopper, Telepathy

list = Accounts(
    {"No account selected": , "Account (sarkozi.reka.00@gmail.com | https://app.speckle.systems)": "https://app.speckle.systems/?id=f5d07a1ef0", "Account (sarkozi.reka@paulinyiandpartners.com | https://app.speckle.systems)": "https://app.speckle.systems/?id=5b8351a0fa"}, selected="Account (sarkozi.reka@paulinyiandpartners.com | https://app.speckle.systems)",
    FirstSelectedItem="https://app.speckle.systems/?id=5b8351a0fa")

panel = Panel("""00
01
02""")
panel_2 = Panel("""A
B""")
buildings = RemoteSender(panel)
versions = RemoteSender(panel_2)
project = RemoteSender("PROJ01")

screate = CreateStream(SpeckleAccount=list, stream="aa34c870ea https://app.speckle.systems 5b8351a0fa")
screate_2 = CreateStream(SpeckleAccount=list, stream="be8d705ab3 https://app.speckle.systems 5b8351a0fa")
screate_3 = CreateStream(SpeckleAccount=list, stream="07c863dbe1 https://app.speckle.systems 5b8351a0fa")
screate_4 = CreateStream(SpeckleAccount=list, stream="c0ae2554f5 https://app.speckle.systems 5b8351a0fa")
screate_5 = CreateStream(SpeckleAccount=list, stream="35dacf1143 https://app.speckle.systems 5b8351a0fa")
screate_6 = CreateStream(SpeckleAccount=list, stream="2c8d133adc https://app.speckle.systems 5b8351a0fa")
screate_7 = CreateStream(SpeckleAccount=list, stream="6be01ac84c https://app.speckle.systems 5b8351a0fa")
merge = Merge(Data1=screate, Data2=screate_2, Data3=screate_3, Data4=screate_4, Data5=screate_5, Data6=screate_6, Data7=screate_7)
dam = DataDam(DataA=merge, BufferDelay=10000000, BufferMode=0)

buildings_2 = RemoteReceiver(buildings)
versions_2 = RemoteReceiver(versions)
buildings_3 = RemoteReceiver(buildings)
project_2 = RemoteReceiver(project)
crossref = CrossReference(ListA=buildings_2, ListB=versions_2, CrossMode=1)  # -> ListA, ListB
project_3 = RemoteReceiver(project)
versions_3 = RemoteReceiver(versions)
replace = ReplaceItems(List=buildings_3, Item="main", Indices=0, Wrap=False)
concat = Concatenate(FragmentA=project_2, FragmentB="-", FragmentC=crossref.ListB, FragmentD=crossref.ListA)
concat_2 = Concatenate(FragmentA=project_3, FragmentB="-", FragmentC="00")
crossref_2 = CrossReference(ListA=replace, ListB=versions_3, CrossMode=1)  # -> ListA, ListB
streamversions = RemoteSender(crossref_2.ListB)
streamstages = RemoteSender(crossref_2.ListA)
streamnames = RemoteSender(concat)
merge_2 = Merge(Data1=concat_2, Data2=concat)
concat_3 = Concatenate(FragmentA="version:", FragmentB=crossref_2.ListB, FragmentC=", stage:", FragmentD=crossref_2.ListA)
merge_3 = Merge(Data1=flatten("main"), Data2=flatten(concat_3))
panel_3 = Panel(merge_2)
sup = StreamUpdate(Stream=dam, Name=merge_2, Description=merge_3)  # disabled
panel_4 = Panel(merge_3)

lng = ListLength(List=merge)

# ----
# 1. create speckle stream
streamnames_2 = RemoteReceiver(streamnames)
lng_2 = ListLength(List=streamnames_2)  # -> expr("x+1", Length)
subtraction = Subtraction(A=lng_2, B=lng)
series = Series(Start=100, Step=40, Count=subtraction)
concat_4 = Concatenate(FragmentA="0,", FragmentB=series)
screate_8 = CreateStream()
connected = GetConnectedObjects(Objects=screate_8)
create = InstantiateObject(Run=Button(), Object=connected, Location=concat_4)

dam_2 = DataDam(DataA=dam, BufferDelay=10000000, BufferMode=0)

# ----
# 2. rename
# speckle stream
falsestart = LBFalseStartToggle(False)
onoff = EnableDisableObject(Enabled=falsestart, AllObjects_Object=sup)

sdet = StreamDetails(Stream=dam_2)  # -> StreamID, Name, Description, CreatedAt, UpdatedAt, Public, Collaborators, Branches
panel_5 = Panel(sdet.Name)
panel_6 = Panel(sdet.Description)

crole = ChangeRole()  # -> Collaborators, Message

# ----
# 3. create speckle branch
# 4. send stream links
panel_7 = Panel("https://speckle.xyz/streams/")
concat_5 = Concatenate(FragmentA=panel_7, FragmentB=sdet.StreamID)
split = SplitList(List=concat_5, Index=1)  # -> ListA, ListB
streamversions_2 = RemoteReceiver(streamversions)
streamnames_3 = RemoteReceiver(streamnames)
streamstages_2 = RemoteReceiver(streamstages)
projectstream = RemoteSender(split.ListA)
projectstream_2 = RemoteReceiver(projectstream)
txt = Text(split.ListB)
cso = CreateSpeckleObject(_1_link=txt, _2_name=streamnames_3, _3_version=streamversions_2, _4_stage=streamstages_2, selectedKitName="Objects")
concat_6 = Concatenate(FragmentA=projectstream_2, FragmentB="/branches/", FragmentC="streams")
send = Send(
    Stream=concat_6,
    Data=cso,
    AutoSend=False,
    BaseId="7a4bbaa485a6b950d158147b18a36384",
    CurrentComponentState="up_to_date",
    KitName="Objects",
    OutputWrappers="https://app.speckle.systems\taa34c870ea\t26c00889e3",
    UseDefaultCache=True,
    selectedKitName="Objects")
panel_8 = Panel(send)

bcreate = BranchCreatorComponent(
    StreamUrlOrId=split.ListA,
    BranchName="streams",
    Description="contains the streams belonging to the project",
    Run=Button())

rec = DataRecorder(bcreate, DataLimit=-10, RecordData=True)
panel_9 = Panel(rec)

projectstream_3 = RemoteReceiver(projectstream)
concat_7 = Concatenate(FragmentA=projectstream_3, FragmentB="/branches/streams")

receive = Receive(
    Stream=concat_7,
    AutoReceive=False,
    CurrentComponentState="up_to_date",
    ExpandOutput=True,
    LastInfoMessage="Réka Sárközi @ 06/09/2024 10:52:39: Pushed 8 elements from Grasshopper. (id:26c00889e3)",
    ReceiveOnOpen=False,
    ReceivedCommitId="26c00889e3",
    StreamWrapper="https://speckle.xyz/streams/aa34c870ea/branches/streams",
    selectedKitName="Objects")  # -> Info, Data

dso = DeconstructSpeckleObject(SpeckleObject=receive.Data, selectedKitName="Objects")  # -> flatten(_1_link), _2_name, flatten(_3_version), flatten(_4_stage)
entwine = Entwine(Branch00=dso._3_version, Branch01=dso._4_stage, FlattenInputs=True)
cset = CreateSet(List=entwine)  # -> Set, Map
pickitem = PickItem(cset.Set, MODE=1)
mindex = MemberIndex(Set=entwine, Member=pickitem)  # -> Index, Count
bang = ExplodeTree(Data=mindex.Index)  # -> Branch0, Branch1
intersection = SetIntersection(SetA=bang.Branch0, SetB=bang.Branch1)
item = ListItem(List=dso._1_link, Index=intersection, Wrap=True)
panel_10 = Panel(item)

sdet_2 = StreamDetails(Stream=dso._1_link)  # -> StreamID, Name, Description, CreatedAt, UpdatedAt, Public, Collaborators, Branches
cadd = CollaboratorInvite(Stream=sdet_2.StreamID)
